# Grasshopper definition 03_4_clipping plane animation.gh (Grasshopper 0.9.76)

id = Guid(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)
geo = Geometry([<mesh referenced from the Rhino model> x18, <brep referenced from the Rhino model>, <curve referenced from the Rhino model>, <brep referenced from the Rhino model>, <curve referenced from the Rhino model>, <brep referenced from the Rhino model>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])
# import a clipping plane
# from Rhino here
animation_slider = Slider(1, range=0..1)
bbox = BoundingBox(Content=geo, Plane=PlaneXY(0, 0, 0), UnionBox=True)  # -> Box, Box_2
box = EvaluateBox(Box=bbox.Box, UParameter=0.5, VParameter=0.5, WParameter=0.5)  # -> Plane, Point, Include
scale = Scale(Geometry=bbox.Box, Center=box.Point, Factor=Slider(1.2, range=1..2))  # -> Geometry, Transform
box_corners = BoxCorners(Box=scale.Geometry)  # -> CornerA, CornerB, CornerC, CornerD, CornerE, CornerF, CornerG, CornerH
pdecon = Deconstruct(Point=box_corners.CornerE)  # -> XComponent, YComponent, ZComponent
pdecon_2 = Deconstruct(Point=box_corners.CornerA)  # -> XComponent, YComponent, ZComponent
max_z = Slider(135, range=55..190)
min_z = Slider(120, range=50..180)
# <title>
# 
# <description>
# 
# code by <author>
# 
# v <version>
# 
# © Co-de-iT 2018 _ Creative Commons Attribution-NonCommercial-ShareAlike 4.0 International License
# easing animation
graph = GraphMapper(
    animation_slider,
    x0=0,
    x1=1,
    y0=0,
    y1=1,
    container_name="Bezier",
    cpx=[0, 0, 0.9923480749, 1],
    cpy=[0, 0.413043499, 0.593565166, 1])
dom = Domain(DomainStart=pdecon_2.ZComponent, DomainEnd=pdecon.ZComponent)
pt = Point(Point(0, 0, 0))
pt_2 = Point(Point(1, 0, 0))
pt_3 = Point(Point(0, -1, 0))
boxprop = BoxProperties(Box=bbox.Box)  # -> Center, Diagonal, Area, Volume, Degeneracy
pdecon_3 = Deconstruct(Point=box.Point)  # -> XComponent, YComponent, ZComponent
pl_3pt = Plane3Pt(PointA=pt, PointB=pt_2, PointC=pt_3)
devec = DeconstructVector(Vector=boxprop.Diagonal)  # -> XComponent, YComponent, ZComponent
remap = RemapNumbers(Value=graph, Source=Domain(0, 1), Target=dom)  # -> Mapped, Clipped
pt_4 = ConstructPoint(XCoordinate=pdecon_3.XComponent, YCoordinate=pdecon_3.YComponent, ZCoordinate=remap.Mapped)

pt_5 = ConstructPoint(XCoordinate=Slider(122.11, range=-2..200), YCoordinate=Slider(2, range=-2..2), ZCoordinate=remap.Mapped)
# < move plane out of sight
# custom plane with
# negative Z
# to look down
pl_origin = PlaneOrigin(Base=pl_3pt, Origin=pt_5)

c_script = CSharpScript(L=devec.YComponent)  # -> D; inputs L: Double
# ---------- c_script: C# ----------
    D = new Interval(-L * 0.5, L * 0.5);
# ---------- end c_script ----------
c_script_2 = CSharpScript(L=devec.XComponent)  # -> D; inputs L: Double; same code as c_script
pl_origin_2 = PlaneOrigin(Base=pl_3pt, Origin=pt_4)
Z = UnitZ(Factor=Slider(-0.03, range=-1..0))
move = Move(Geometry=pl_origin_2, Motion=Z)  # -> Geometry, Transform
rectangle = Rectangle(Plane=move.Geometry, XSize=c_script_2, YSize=c_script, Radius=0)  # -> Rectangle, Length
scale_2 = Scale(Geometry=rectangle.Rectangle, Center=move.Geometry, Factor=Slider(1.184, range=1..2))  # -> Geometry, Transform
boundary = BoundarySurfaces(Edges=scale_2.Geometry)
c_script_3 = CSharpScript(id=id, y=pl_origin)  # -> out, A; inputs id: Guid, y: Plane
# ---------- c_script_3: C# ----------
    Rhino.DocObjects.ObjRef obj = new Rhino.DocObjects.ObjRef(id);
    Rhino.DocObjects.ClippingPlaneObject cpObj = obj.Object() as Rhino.DocObjects.ClippingPlaneObject;
    cpObj.ClippingPlaneGeometry.Plane = y;
    cpObj.CommitChanges();
# ---------- end c_script_3 ----------
